# Grasshopper definition dev.ghx (Grasshopper 1.0.7)
# plug-ins: LunchBox

# ['C:\\Users\\yoshioca\\Documents\\Mesh_Vertex_Color\\gh', 'C:\\Program Files\\Rhino 6\\Plug-ins\\IronPython\\Lib', 'C:\\Users\\yoshioca\\AppData\\Roaming\\McNeel\\Rhinoceros\\6.0\\Plug-ins\\IronPython (814d908a-e25c-493d-97e9-ee3861957f49)\\settings\\lib', 'C:\\Users\\yoshioca\\AppData\\Roaming\\McNeel\\Rhinoceros\\6.0\\scripts', '/Users/yoshionao_mbp/Documents/Digital_Artisan/Mesh_Vertex_Color', '/Users/yoshionao_mbp/Documents/Digital_Artisan/Mesh_Vertex_Color', '/Users/yoshionao_mbp/Documents/Digital_Artisan/Mesh_Vertex_Color', '/Users/yoshionao_mbp/Documents/Digital_Artisan/Mesh_Vertex_Color']
panel = Panel("C:\Users\yoshioca\Documents\Mesh_Vertex_Color")
panel_2 = Panel("/Users/yoshionao_mbp/Documents/Digital_Artisan/Mesh_Vertex_Color")
pt = ConstructPoint(XCoordinate=Slider(10, range=0..10), YCoordinate=Slider(9, range=0..10), ZCoordinate=Slider(10, range=0..10))
pt_2 = ConstructPoint(XCoordinate=Slider(6, range=0..10), YCoordinate=Slider(2, range=0..10), ZCoordinate=Slider(0, range=0..10))
pt_3 = ConstructPoint(XCoordinate=Slider(0, range=0..10), YCoordinate=0, ZCoordinate=0)
pt_4 = ConstructPoint(XCoordinate=Slider(4, range=0..10), YCoordinate=Slider(10, range=0..10), ZCoordinate=0)
pt_5 = ConstructPoint(XCoordinate=Slider(8, range=0..10), YCoordinate=0, ZCoordinate=Slider(0, range=0..10))
merge = Merge(Data1=pt, Data2=pt_2)
button = Button()
merge_2 = Merge(Data1=pt_3, Data2=pt_4, Data3=pt_5)
xy = XYPlane(Origin=Point(0, 0, 0))
mesh = Mesh(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)
python = GhPythonScript()  # -> out, a; unedited script template

# ---- group: TEST
pt_6 = Point([Point(11.64376645, 10.93991172, 0), Point(12.21114581, 34.65636874, 0), Point(36.47058486, 22.09061818, 0)])

# ----
demesh = DeconstructMesh(Mesh=mesh)  # -> Vertices, Faces, Colours, Normals
pt_7 = ConstructPoint(XCoordinate=0, YCoordinate=0, ZCoordinate=0)
panel_3 = Panel(pt_7)
pt_8 = Point(merge)
python_2 = GhPythonScript(PATH_MAC=panel_2, PATH_LAPTOP=panel, BOOL=Toggle(True))  # -> out
# ---------- python_2: Python ----------
import sys

if BOOL:
#    sys.path.append(PATH_MAC)
     sys.path.append(PATH_LAPTOP)    
    # sys.path.append(PATH_DESKTOP)

print(sys.path)
# ---------- end python_2 ----------

# ---- group: TEST
pt_9 = Point(merge_2)

# ----
sec = MeshPlane(Mesh=mesh, Plane=xy)
pt_10 = Point(demesh.Vertices)
python_3 = GhPythonScript(NUM=Slider(50, range=0..100), ATTRACTORS=pt_6)  # -> out, POINTS, FACES, CALC; inputs ATTRACTORS: list
# ---------- python_3: Python ----------
import math
import rhinoscriptsyntax as rs


from mesh_vertex_color import operate_mesh
reload(operate_mesh)


om = operate_mesh.OperateMesh()


num = int(NUM) + 1
attractors = ATTRACTORS


points = om.define_mesh_points_triangle(num)
faces = om.define_mesh_faces(num)


POINTS = points
FACES = faces

def calc_distance_2pt(pt0, pt1):
    
    dx = pt1[0] - pt0[0]
    dy = pt1[1] - pt0[1]
    dz = pt1[2] - pt0[2]
    
    l = math.sqrt((dx * dx) + (dy * dy) + (dz * dz))
    
    return l


def calc_mesh_color(base_pts, atr_pts):
    
    base_pts = rs.coerce3dpointlist(base_pts)
    atr_pts = rs.coerce3dpointlist(atr_pts)
    
    i_count = len(base_pts)
    j_count = len(atr_pts)
    
    len_list = []
    
    for i in xrange(i_count):
        
        tmp_list = []
        
        for j in xrange(j_count):
            tmp_list.append(calc_distance_2pt(base_pts[i], atr_pts[j]))
        
            # print(tmp_list)
            # print(min(tmp_list))
        
        len_list.append(min(tmp_list))
    
    return len_list

calc_color = calc_mesh_color(points, attractors)
CALC = calc_color
# ---------- end python_3 ----------
panel_4 = Panel(python_3.FACES)
bbox = BoundingBox(Content=python_3.POINTS, Plane=PlaneXY(0, 0, 0), UnionBox=True)  # -> Box, Box_2
area = Area(Geometry=bbox.Box)  # -> Area, Centroid
dist = Distance(PointA=python_3.POINTS, PointB=area.Centroid)
panel_5 = Panel(dist)
ln = Line(StartPoint=python_3.POINTS, EndPoint=pt_7)
panel_6 = Panel(python_2)
viewer = ParamViewer(python_3.POINTS)
python_4 = GhPythonScript(NUM=Slider(50, range=0..100), TRIANGLE=pt_9, RAY=pt_8)  # -> out, POINTS, FACES, CALC, a, b, c; inputs TRIANGLE: list, RAY: list
# ---------- python_4: Python ----------
import math
import rhinoscriptsyntax as rs


from mesh_vertex_color import operate_mesh
from mesh_vertex_color import ray_triangle_intersection

reload(operate_mesh)
reload(ray_triangle_intersection)

om = operate_mesh.OperateMesh()
rt = ray_triangle_intersection.RayTriangleIntersection()

v0, v1, v2 = rs.coerce3dpointlist(TRIANGLE)
o, o2 = rs.coerce3dpointlist(RAY)
d = o2 - o

a = o
b = d


pr = rt.calc_intersection(o, d, v0, v1, v2)
#print(pr)


if pr != None:
    c = rs.AddPoint(pr)
# ---------- end python_4 ----------
panel_7 = Panel(python_4.out)
viewer_2 = ParamViewer(python_3.CALC)
pline = PolyLine(Vertices=pt_9, Closed=True)
pline_2 = PolyLine(Vertices=pt_8, Closed=False)
bnd = Bounds(Numbers=python_3.CALC)
boundary = BoundarySurfaces(Edges=pline)
sph = Sphere(Base=python_4.a, Radius=1)
bcx = BrepCurve(Brep=boundary, Curve=pline_2)  # -> Curves, Points
lng = ListLength(List=python_3.POINTS)
trib = TrianglePanelsB(UDivisions=10, VDivisions=10)
vdis = VectorDisplay(Anchor=python_4.a, Vector=python_4.b)
pt_11 = Point(python_3.POINTS)
panel_8 = Panel(python_4.c)
panel_9 = Panel(pt_11)
remap = RemapNumbers(Value=python_3.CALC, Source=bnd, Target="0.0 to 2.0")  # -> Mapped, Clipped
hsv = ColourHSV(Alpha=1, Hue=remap.Mapped, Saturation=1, Value=1)
sph_2 = Sphere(Base=python_4.c, Radius=0.1)
panel_10 = Panel(lng)
conmesh = ConstructMesh(Vertices=python_3.POINTS, Faces=python_3.FACES, Colours=hsv)
panel_11 = Panel(bnd)
panel_12 = Panel(remap.Mapped)
panel_13 = Panel(python_3.POINTS)
preview = CustomPreview(Geometry=sph_2, Material=ColourSwatch(SwatchColor=RGB(255, 0, 255)))
medges = MeshEdges(Mesh=conmesh)  # -> NakedEdges, InteriorEdges, NonManifoldEdges
